# Grasshopper definition ZipTies.gh (Grasshopper 1.0.7)

# ---- group: random pattern
count = Slider(78, range=1..200)
seed = Slider(2, range=0..50)
curve = Curve(<curve referenced from the Rhino model>)
populate_2d = Populate2D(Region=curve, Count=count, Seed=seed)

# ----
angle = Slider(81, range=0..180)

# ---- group: straight line
count_2 = Slider(6, range=1..20)
unit_y = UnitY(Factor=1)
point = Point(Point(53.94307664, 46.61978343, 0))
linear_array = LinearArray(Geometry=point, Direction=unit_y, Count=count_2)  # -> Geometry, Transform

# ---- group: OLD DO NOT USE
rebuild_curve = RebuildCurve(Degree=Slider(3, range=2..5), Count=Slider(2, range=2..5), Tangents=False)
interpolate = Interpolate(Degree=3, Periodic=False, KnotStyle=1)  # -> Curve, Length, Domain
list_length = ListLength()
division = Division(A=list_length, B=Slider(3, range=0..5))
partition_list = PartitionList(Size=division)
flip_matrix = FlipMatrix(Data=partition_list)
polyline = PolyLine(Vertices=flip_matrix, Closed=False)
rebuild_curve_2 = RebuildCurve(Curve=polyline, Degree=Slider(4, range=1..5), Count=Slider(3, range=2..5), Tangents=False)

# ----
curve_2 = Curve(<curve referenced from the Rhino model>)
count_3 = Slider(14, range=1..20)
area = Area(Geometry=curve_2)  # -> Area, Centroid
radians = Radians(Degrees=angle)
rectangular_array = RectangularArray(Geometry=point, Cell=curve, XCount=Slider(2, range=1..10), YCount=Slider(3, range=1..10))  # -> Geometry, Transform
curve_3 = Curve(<curve referenced from the Rhino model>)
radius = Slider(4, range=0..10)
distance = Slider(0.08, range=0.01..0.1)
polar_array = PolarArray(Geometry=curve_3, Plane=area.Centroid, Count=count_3, Angle=radians)  # -> Geometry, Transform
voronoi = Voronoi(Points=populate_2d, Radius=radius, Boundary=curve, BruteForceOverride=False)
offset_curve = OffsetCurve(Curve=polar_array.Geometry, Distance=distance, Plane=PlaneXY(0, 0, 0), Corners=1)
factor = Slider(0.9, range=0.2..1.2)
area_2 = Area(Geometry=voronoi)  # -> Area, Centroid
explode = Explode(Curve=[offset_curve, polar_array.Geometry], Recursive=True)  # -> Segments, Vertices
scale = Scale(Geometry=voronoi, Center=area_2.Centroid, Factor=factor)  # -> Geometry, Transform
cull_pattern = CullPattern(List=explode.Vertices, CullPattern=[True, False])
list_item = ListItem(List=explode.Vertices, Index=0, Wrap=True)
explode_2 = Explode(Curve=scale.Geometry, Recursive=True)  # -> Segments, Vertices
line = Line(StartPoint=list_item, EndPoint=cull_pattern)
nurbs_curve = NurbsCurve(Vertices=explode_2.Vertices, Degree=3, Periodic=False)  # -> Curve, Length, Domain

# ---- group: rotate zip ties
list_item_2 = ListItem(List=nurbs_curve.Curve, Index=0, Wrap=True)
graft_tree = GraftTree(Tree=area_2.Centroid, IncludeEmptyLists=True, IncludeNullItems=True)
angle_2 = Slider(90, range=0..180)
unit_z = UnitZ(Factor=1)
radians_2 = Radians(Degrees=angle_2)
rotate_3d = Rotate3D(Geometry=list_item_2, Angle=radians_2, Center=graft_tree, Axis=unit_z)  # -> Geometry, Transform

# ----
cull_pattern_2 = CullPattern(CullPattern=[True, False])
distance_2 = Slider(0.06, range=0.01..0.1)
offset_curve_2 = OffsetCurve(Curve=nurbs_curve.Curve, Distance=distance_2, Plane=PlaneXY(0, 0, 0), Corners=1)
